# Grasshopper definition grasshopper-assignment2.gh (Grasshopper 1.0.7)

point = Point(Point(0, 0, 0))
point_2 = Point(Point(45, 0, 0))
polygon = Polygon(Plane=point, Radius=Slider(20, range=1..50), Segments=Slider(3, range=1..10), FilletRadius=0)  # -> Polygon, Length
polygon_2 = Polygon(Plane=point_2, Radius=Slider(20, range=1..50), Segments=Slider(4, range=1..10), FilletRadius=0)  # -> Polygon, Length
deconstruct_brep = DeconstructBrep(Brep=polygon.Polygon)  # -> Faces, Edges, Vertices
deconstruct_brep_2 = DeconstructBrep(Brep=polygon_2.Polygon)  # -> Faces, Edges, Vertices
length = Length(Curve=deconstruct_brep.Edges)
addition = Addition(A=Slider(3, range=0..10), B=Slider(1, range=0..1))
boolean_toggle = BooleanToggle(True)
curve_middle = CurveMiddle(Curve=deconstruct_brep.Edges)
length_2 = Length(Curve=deconstruct_brep_2.Edges)
addition_2 = Addition(A=Slider(3, range=0..10), B=Slider(1, range=0..1))
boolean_toggle_2 = BooleanToggle(True)
division = Division(A=Slider(3, range=0.1..5), B=length)
curve_middle_2 = CurveMiddle(Curve=deconstruct_brep_2.Edges)
curve = Curve(deconstruct_brep.Edges)
division_2 = Division(A=Slider(3, range=0.1..5), B=length_2)
curve_2 = Curve(deconstruct_brep_2.Edges)
vector_2pt = Vector2Pt(PointA=curve_middle, PointB=point, Unitize=boolean_toggle)  # -> Vector, Length
scale = Scale(Geometry=curve, Center=curve_middle, Factor=division)  # -> Geometry, Transform
vector_2pt_2 = Vector2Pt(PointA=point, PointB=curve_middle, Unitize=boolean_toggle)  # -> Vector, Length
vector_2pt_3 = Vector2Pt(PointA=curve_middle_2, PointB=point_2, Unitize=boolean_toggle_2)  # -> Vector, Length
scale_2 = Scale(Geometry=curve_2, Center=curve_middle_2, Factor=division_2)  # -> Geometry, Transform
vector_2pt_4 = Vector2Pt(PointA=point_2, PointB=curve_middle_2, Unitize=boolean_toggle_2)  # -> Vector, Length
amplitude = Amplitude(Vector=vector_2pt.Vector, Amplitude=addition)
amplitude_2 = Amplitude(Vector=vector_2pt_3.Vector, Amplitude=addition_2)
extrude = Extrude(Base=scale.Geometry, Direction=amplitude)
extrude_2 = Extrude(Base=scale_2.Geometry, Direction=amplitude_2)
move = Move(Geometry=extrude, Motion=vector_2pt_2.Vector)  # -> Geometry, Transform
curve_3 = Curve(polygon.Polygon)
move_2 = Move(Geometry=extrude_2, Motion=vector_2pt_4.Vector)  # -> Geometry, Transform
curve_4 = Curve(polygon_2.Polygon)
trim_with_regions = TrimWithRegions(Curve=move.Geometry, Regions=curve_3)  # -> Inside, Outside
trim_with_regions_2 = TrimWithRegions(Curve=curve_3, Regions=move.Geometry)  # -> Inside, Outside
trim_with_regions_3 = TrimWithRegions(Curve=move_2.Geometry, Regions=curve_4)  # -> Inside, Outside
trim_with_regions_4 = TrimWithRegions(Curve=curve_4, Regions=move_2.Geometry)  # -> Inside, Outside
curve_5 = Curve(flatten(trim_with_regions_2.Outside))
curve_6 = Curve(flatten(trim_with_regions.Inside))
curve_7 = Curve(flatten(trim_with_regions_4.Outside))
curve_8 = Curve(flatten(trim_with_regions_3.Inside))
panel = Panel(curve_5)
join_curves = JoinCurves(Curves=[curve_5, curve_6], Preserve=False)
panel_2 = Panel(curve_7)
join_curves_2 = JoinCurves(Curves=[curve_7, curve_8], Preserve=False)
panel_3 = Panel(join_curves)
panel_4 = Panel(join_curves_2)
