# Grasshopper definition triangular.gh (Grasshopper 1.0.7)
# plug-ins: LunchBox

factor = Slider(50, range=0..100)
radius = Slider(22, range=0..100)
xy_plane = XYPlane(Origin=Point(0, 0, 0))
circle = Circle(Plane=xy_plane, Radius=radius)
unit_z = UnitZ(Factor=factor)
extrude = Extrude(Base=circle, Direction=unit_z)
radius_2 = Slider(10, range=0..20)
radius_3 = Slider(12, range=0..20)
brep_edges = BrepEdges(Brep=extrude)  # -> Naked, Interior, NonManifold
triangle_panels_b = TrianglePanelsB(Surface=extrude, UDivisions=radius_2, VDivisions=radius_3)
curve = Curve(brep_edges.Interior)
divide_curve = DivideCurve(Curve=curve, Count=radius_2, Kinks=False)  # -> Points, Tangents, Parameters
area = Area(Geometry=triangle_panels_b)  # -> Area, Centroid
curve_closest_point = CurveClosestPoint(Point=area.Centroid, Curve=brep_edges.Interior)  # -> Point, Parameter, Distance
sort_list = SortList(Keys=curve_closest_point.Distance)  # -> Keys, ValuesA
number_slider = Slider(0.1, range=0..0.1)
list_item = ListItem(List=sort_list.Keys, Index=0, Wrap=True)
addition = Addition(A=list_item, B="0.1")
smaller_than = SmallerThan(FirstNumber=curve_closest_point.Distance, SecondNumber=addition)  # -> SmallerThan, OrEqualTo
dispatch = Dispatch(List=triangle_panels_b, DispatchPattern=smaller_than.SmallerThan)  # -> ListA, ListB
partition_list = PartitionList(List=dispatch.ListA, Size="2")
brep_join = BrepJoin(Breps=partition_list)  # -> flatten(Breps), Closed
panel = Panel("""false
true""")
cull_pattern = CullPattern(List=divide_curve.Points, CullPattern=panel)
discontinuity = Discontinuity(Curve=brep_join.Breps, Level=1)  # -> Points, Parameters
pull_point = PullPoint(Point=discontinuity.Points, Geometry=cull_pattern, ClosestOnly=True)  # -> ClosestPoint, Distance
larger_than = LargerThan(FirstNumber=pull_point.Distance, SecondNumber="0.1")  # -> LargerThan, OrEqualTo
cull_pattern_2 = CullPattern(List=discontinuity.Points, CullPattern=larger_than.LargerThan)
polyline = PolyLine(Vertices=cull_pattern_2, Closed=invert(False))
boundary_surfaces = BoundarySurfaces(Edges=polyline)
surface = Surface(dispatch.ListB)
brep_join_2 = BrepJoin(Breps=flatten([boundary_surfaces, surface]))  # -> Breps, Closed
cap_holes = CapHoles(Brep=brep_join_2.Breps)
